vi "ஆங்கிலநாள்-தமிழ்நாள்.gviweb"   [G Web Development Software 21.0.0]
inputs:
  "ஆங்கிலநாள்": timestamp
outputs:
  "திங்கள்": T1
  "திங்கள் நாள்": i16
  "ஆண்டு நாள்கள்": f64[][]
  "thiru aandu": i32
  "thirunaal": i32
  "ஆண்டு நாள்": f64
panel indicators:
  "Offset Output": f64
  "Output": f64[]
types:
  T1 = enum{"ஆவணி", "புரட்டாசி", "ஐப்பசி", "கார்த்திகை", "மார்கழி", "தை", "மாசி", "பங்குனி", "சித்திரை", "வைகாசி", "ஆனி", "ஆடி"}
uses:
  நேரம்::குழலிசை::திங்கள்-நாள்கள்.gviweb
diagram:
  Is Equal(x=$"ஆங்கிலநாள்", y=1904-01-01T00:00:00Z) -> w1
  case (w1) {
    frame False, Default {
      w2 = $"ஆங்கிலநாள்"
    }
    frame True {
      Get Current Time() -> (current time=w2)
    }
  }
  Timestamp To Date And Time(time stamp=w2) -> (date time rec=w3)
  Property Node(instance in=w3) -> ("year"=w4, "day of year"=w5)
  Quotient And Remainder(x=w4, y=4) -> (x-y*floor(x/y)=w6)
  Is Equal To 0(x=w6) -> w7
  Boolean To 0 Or 1(Boolean=w7) -> (0, 1=w8)
  case (w5) {
    frame ..228 {
      Decrement(x=w4) -> w9
      Add(w8, 365, w5) -> w10
    }
    frame 229.. {
      w9 = w4
      w10 = w5
    }
  }
  Add(w9, 31) -> w11
  Subtract(x=w10, y=228) -> w12
  Subtract(x=w12, y=179) -> w13
  case (w13) {
    frame Default {
      w14 = w13
      w15 = w11
    }
    frame ..0 {
      Decrement(x=w11) -> w15
      Add(w13, 365) -> w14
    }
  }
  $"thiru aandu" <- w15
  $thirunaal <- w14
  Subtract(x=w4, y=2020) -> w16
  Increment(x=w16) -> w17
  s1 = 0.17412  # shift register
  s2 = 0  # shift register
  for (N = w17) {
    call "திங்கள்-நாள்கள்.gviweb"(கூட்டுதொடக்கம்=s2, ஈடுசெய்=s1) -> (கூட்டுதொகை=w20, ஈடுமீதம்=w21, கூட்டுமுழுநாள்கள்=w22, முழுநாள்கள்=w23)
    append w23 to w18
    concatenate w22 onto w19
    next s1 = w21
    next s2 = w20
  }
  $"ஆண்டு நாள்கள்" <- w18
  $"Offset Output" <- s1
  $Output <- w19
  Timestamp Subtract(x=w2, y=2021-08-15T12:30:00Z) -> w24
  Quotient And Remainder(x=w24, y=86400) -> (floor(x/y)=w25)
  Threshold 1D Array(array of numbers or points=w19, threshold y=w25) -> w26
  Round Toward Positive Infinity(x=w26) -> w27
  Decrement(x=w27) -> w28
  Array Index(array=w19) -> (out0[w28]=w29)
  Subtract(x=w25, y=w29) -> w30
  $"திங்கள் நாள்" <- w30
  To Unsigned 16 Bit Integer(number=w27) -> w31
  Quotient And Remainder(x=w31, y=12) -> (x-y*floor(x/y)=w32)
  $"திங்கள்" <- w32
  $"ஆண்டு நாள்" <- w25
