vi "குறள்படி.gviweb"   [G Web Development Software 21.0.0]
inputs:
  "அடைவு": u16, required
outputs:
  "திருக்குறள்": string
  "தகவல்": T3
  "பொருள்": string[]
  "குறள் எண்": u16
types:
  T1 = enum{"பாயிரவியல்", "இல்லறவியல்", "துறவறவியல்", "ஊழியல் ", "அரசியல்", "அமைச்சியல்", "அரணியல்", "கூழியல்", "படையில்", "நட்பியல்", "குடியியல்", "களவியல்", "கற்பியல்"}
  T2 = enum{"கடவுள் வாழ்த்து", "வான்சிறப்பு", "நீத்தார் பெருமை", "அறன்வலியுறுத்தல்", "இல்வாழ்க்கை", "வாழ்க்கைத் துணைநலம்", "மக்கட்பேறு", "அன்புடைமை", "விருந்தோம்பல்", "இனியவைகூறல்", "செய்ந்நன்றி அறிதல்", "நடுவு நிலைமை", "அடக்கமுடைமை", "ஒழுக்கமுடைமை", "பிறனில் விழையாமை", "பொறையுடைமை", "அழுக்காறாமை", "வெஃகாமை", "புறங்கூறாமை", "பயனில சொல்லாமை", "தீவினையச்சம்", "ஒப்புரவறிதல்", "ஈகை", "புகழ்", "அருளுடைமை", "புலான்மறுத்தல்", "தவம்", "கூடாவொழுக்கம்", "கள்ளாமை", "வாய்மை", "வெகுளாமை", "இன்னாசெய்யாமை", "கொல்லாமை", "நிலையாமை", "துறவு", "மெய்யுணர்தல்", "அவாவறுத்தல்", "ஊழ்", "இறைமாட்சி", "கல்வி", "கல்லாமை", "கேள்வி", "அறிவுடைமை", "குற்றங்கடிதல்", "பெரியாரைத் துணைக்கோடல்", "சிற்றினஞ்சேராமை", "தெரிந்துசெயல்வகை", "வலியறிதல்", "காலமறிதல்", "இடனறிதல்", "தெரிந்துதெளிதல்", "தெரிந்துவினையாடல்", "சுற்றந்தழால்", "பொச்சாவாமை", "செங்கோன்மை", "கொடுங்கோன்மை", "வெருவந்தசெய்யாமை", "கண்ணோட்டம்", "ஒற்றாடல்", "ஊக்கமுடைமை"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}
  T3 = cluster{"பால்": enum{"அறம்", "பொருள்", "இன்பம்"}, "இயல்": T1, "அதிகாரம்": T2}
uses:
  நேரம்::குழலிசை::குறளிசை.gviweb
  NI::HTTP::GET.gvi
diagram:
  Quotient And Remainder(x=$"அடைவு", y=1330) -> (x-y*floor(x/y)=w1)
  Increment(x=w1) -> w2
  case (w2) {
    frame 1..380, Default {
      w3 = "அறம்"
    }
    frame 381..1080 {
      w3 = "பொருள்"
    }
    frame 1081..1330 {
      w3 = "இன்பம்"
    }
  }
  case (w2) {
    frame 1..40, Default {
      w4 = "பாயிரவியல்"
    }
    frame 41..240 {
      w4 = "இல்லறவியல்"
    }
    frame 241..370 {
      w4 = "துறவறவியல்"
    }
    frame 371..380 {
      w4 = "ஊழியல் "
    }
    frame 381..630 {
      w4 = "அரசியல்"
    }
    frame 631..730 {
      w4 = "அமைச்சியல்"
    }
    frame 731..750 {
      w4 = "அரணியல்"
    }
    frame 751..760 {
      w4 = "கூழியல்"
    }
    frame 761..780 {
      w4 = "படையில்"
    }
    frame 781..950 {
      w4 = "நட்பியல்"
    }
    frame 951..1080 {
      w4 = "குடியியல்"
    }
    frame 1081..1150 {
      w4 = "களவியல்"
    }
    frame 1151..1330 {
      w4 = "கற்பியல்"
    }
  }
  Quotient And Remainder(x=w1, y=10) -> (floor(x/y)=w5)
  Build Cluster(w3, w4, w5) -> w6
  $"தகவல்" <- w6
  $"குறள் எண்" <- w2
  w7 = [TRUE, FALSE, TRUE, FALSE, TRUE, TRUE, TRUE, FALSE, FALSE, TRUE, TRUE, TRUE, TRUE, TRUE, TRUE, TRUE, TRUE, TRUE, TRUE]
  disable {
    frame Enabled {
      call "குறளிசை.gviweb"(தொடக்கம்=w2) -> (Kural=w10, error out=w11)
      case (w11) {
        frame No Error {
          Match Pattern(regular expression="ta=", string=w10) -> (after substring=w12, before substring=w8, match substring=w13)
          Concatenate Strings(w13, w12) -> w14
          s1 = "ta"  # shift register
          for (N = 19) {
            w15 = each element of w7
            Increment(x=s1) -> w16
            Format Into String(formatString="%s%s", w16, "=") -> w17
            Format Into String(formatString="%s", s1) -> w18
            Concatenate Strings(w18, "=") -> w19
            Match Pattern(regular expression=w19, string=w14) -> (after substring=w20)
            Match Pattern(regular expression=w17, string=w20) -> (before substring=w21)
            Concatenate Strings(w21, "\r\n") -> w22
            append w22 to w9 if w15
            next s1 = w16
          }
        }
        frame Error {
          w23 = "﻿கல்லாதான் ஒட்பம் கழியநன் றாயினும்\nகொள்ளார் அறிவுடை யார்.   (௪௱௪ - 404) \n"
          w24 = ["""கல்லாதவனது அறிவு சில சமயங்களிலே மிகவும் நன்றாயிருந்தாலும், அறிவுடையவர்கள் அதனை நன்றென்று ஏற்றுக் கொள்ள மாட்டார்கள்  (௪௱௪)

""", "The learned will not acknowledge An ignoramus' occasional knowledge.\n\r\n", "చదువు లేని వాని శాస్త్రజ్ఞు లొప్పరు\nతేలివితేట లెన్ని గలిగియున్న. (౪౦౪)\n\r\n", "വിദ്യയില്ലാത്തവൻ വാക്യം യോഗ്യമാണെന്നിരിക്കിലും  വിജ്ഞരായവരാവാക്യം സ്വീകരിക്കാൻ മറുത്തിടും  (൪൱൪)\n\r\n", "ಕಲಿಯದವನ ಅರಿವು ಬಹಳ ಉತ್ತಮವಾಗಿದ್ದರೂ ಜ್ಞಾನಿಗಳು (ಅದನ್ನು) ಒಪ್ಪಿಕೊಳ್ಳುವುದಿಲ್ಲ. (೪೦೪)\n\r\n", "無學之人, 縱有高見, 仍見輕於士人. (四百四)\n\r\n", """Orang yang tiada berilmu dapat di-anggap sa-bijak yang kau suka: tetapi si-bijaksana tiadakan memberi harga kapada fikiran-nya. 

""", "지혜로운자는무지한자의가끔씩번득이는재기조차허용하지않는다. (四百四)\n\r\n", """Какой бы великой с виду ни была мудрость человека, лишенного знаний, к его словам не склонят ухо люди, умудренные знаниями

""", "الرجل بغير علم ربما يكون عندك حكيما ولكن لا قدر لآراءه عند الحكماء (٤٠٤)\n\r\n", """La connaissance d'un homme sans instruction, si elle est parfois appréciable, n'est pas prisée par les hommes instruits.

""", "Ist des Unwissenden Kenntnis auch gut – der Weise nimmt es nicht an.\n\r\n", "Även om den enfaldiges glimtar av insikt ter sig mycket fina godtas de dock ej såsom vishet av de lärda.\n\r\n", "lndocti ingenium, quamvis sit valde bonum, docti non agnoscunt (CDIV)\n\r\n", "Mędrcy nie chcą się liczyć ze zdaniem tych ludzi, Co są ich towarzystwa nie warci.\n\r\n"]
          call "குறளிசை.gviweb"(தொடக்கம்=404)
          w8 = w23
          w9 = w24
        }
      }
    }
    frame Disabled {
      w25 = "https://getthirukkural.appspot.com/api/2.0/kural/%d?appid=p4nn9zut5iche&format=json"
      Format Into String(formatString=w25, w2) -> w26
      call "GET.gvi"(url=w26) -> (body=w27, error out=w28)
      # {"KuralSet":{"Kural":[{"Number":"130","Line1":"கதங்காத்துக் கற்றடங்கல் ஆற்றுவான் செவ்வி","Line2":"அறம்பார்க்கும் ஆற்றின் நுழைந்து.","Translation":"Virtue seeks and peeps to see  Self-controlled savant anger free"}]}}
      case (w28) {
        frame Error, Default {
          w29 = """மனநலம் மன்னுயிர்க் காக்கம் இனநலம்
எல்லாப் புகழும் தரும்.

மனத்தின் நலம் உயிருக்கு ஆக்கமாக விளங்கும் இனத்தின் நலமோ எல்லாப் புகழையும் வழங்கும்.

Goodness of mind will give wealth, and good society will bring with it all praise, to men."""
          w8 = w29
        }
        frame No Error {
          Match Pattern(regular expression="Line1\":", string=w27) -> (after substring=w30)
          Match Pattern(regular expression="\",\"Line2\":\"", string=w30) -> (after substring=w31, before substring=w32)
          Match Pattern(regular expression="\"Translation\":", string=w31) -> (after substring=w33, before substring=w34)
          Match Pattern(regular expression="}]}}", string=w33) -> (before substring=w35)
          Concatenate Strings(w32, "\r\n", "\r\n", w34, "\r\n", "\r\n", w35) -> w8
        }
      }
    }
  }
  $"திருக்குறள்" <- w8
  $"பொருள்" <- w9
