vi "திங்கள்-நாள்கள்.gviweb"   [G Web Development Software 21.0.0]
inputs:
  "கூட்டுதொடக்கம்": f64
  "ஈடுசெய்": f64
outputs:
  "பருவம்>௴:நாள்கள்": T1[]
  "நாள்கள்": f64[]
  "கூட்டுமுழுநாள்கள்": f64[]
  "கூட்டுதொகை": f64
  "ஈடுமீதம்": f64
  "முழுநாள்கள்": f64[]
  "பருவம்:௴:நாள்கள்": T2[]
  "பருவநாள்கள்": f64[]
  "கூட்டுமுழுபருவநாள்கள்": f64[]
types:
  T1 = cluster{"பருவம்>திங்கள்": string, "data": string}
  T2 = cluster{"பருவம்": string, "௴": string, "நாள்கள்": string}
diagram:
  w1 = [{"பருவம்"="கார்", "௴"="ஆவணி", "நாள்கள்"="31.036111"}, {"பருவம்"="கார்", "௴"="புரட்டாசி", "நாள்கள்"="30.456111"}, {"பருவம்"="கூதிர்", "௴"="ஐப்பசி", "நாள்கள்"="29.901944"}, {"பருவம்"="கூதிர்", "௴"="கார்த்திகை", "நாள்கள்"="29.506667"}, {"பருவம்"="முன்பனி", "௴"="மார்கழி", "நாள்கள்"="29.348056"}, {"பருவம்"="முன்பனி", "௴"="தை", "நாள்கள்"="29.454444"}, {"பருவம்"="பின்பனி", "௴"="மாசி", "நாள்கள்"="29.806667"}, {"பருவம்"="பின்பனி", "௴"="பங்குனி", "நாள்கள்"="30.339261"}, {"பருவம்"="இளவேனில்", "௴"="சித்திரை", "நாள்கள்"="30.925556"}, {"பருவம்"="இளவேனில்", "௴"="வைகாசி", "நாள்கள்"="31.403333"}, {"பருவம்"="முதுவேனில்", "௴"="ஆனி", "நாள்கள்"="31.610556"}, {"பருவம்"="முதுவேனில்", "௴"="ஆடி", "நாள்கள்"="31.470000"}]  # பருவம்:௴:நாள்கள்
  # வ.எண் 	மாதப்பெயர் 	நாள் 	நாடி(60)	விநாடி(60)	தற்பரை(60) 	நாள்(முழுவதும்)
  # 1		ஆவணி	31	2		10		0		31.0361111111111
  # 2		புரட்டாசி 	30	27		22		0		30.4561111111111
  # 3		ஐப்பசி		29	54		7		0		29.9019444444444
  # 4		கார்த்திகை	29	30		24		0		29.5066666666667
  # 5		மார்கழி	29	20		53		0		29.3480555555556
  # 6		தை		29	27		16		0		29.4544444444444
  # 7		மாசி		29	48		24		0		29.8066666666667
  # 8		பங்குனி	30	20		21		15		30.3392361111111
  # 9		சித்திரை	30	55		32		0		30.9255555555556
  # 10		வைகாசி	31	24		12		0		31.4033333333333
  # 11		ஆனி		31	36		38		0		31.6105555555556
  # 12		ஆடி		31	28		12		0		31.47
  #
  # - 		மொத்தம் 	365	15		31		15		365.258680555556
  s1 = $"கூட்டுதொடக்கம்"  # shift register
  s2 = $"ஈடுசெய்"  # shift register
  s3 = uninitialised  # shift register
  for (iteration -> i1) {
    w2 = each element of w1
    Property Node(instance in=w2) -> ("பருவம்"=w10, "௴"=w11, "நாள்கள்"=w12)
    Property Node(instance in=T2 {all zero or empty}, "௴"=w11, "நாள்கள்"=w12) -> (instance out=w13)
    Floating Point String To Number(string=w12) -> (number=w14)
    Add(w14, s2) -> w15
    Round To Nearest(number=w15) -> w16
    case (i1) {
      frame Default {
        Add(s3, w16) -> w18
        w17 = w13
        w19 = TRUE
      }
      frame 0, 2, 4, 6, 8, 10, 12 {
        Property Node(instance in=w13, "பருவம்"=w10) -> (instance out=w17)
        w18 = default
        w19 = default
      }
    }
    Concatenate Strings(w10, "\\", w11) -> w20
    w21 = cluster{"பருவம்>௴": string, "data": string} {all zero or empty}
    Property Node(instance in=w21, "பருவம்>௴"=w20, "data"=w12) -> (instance out=w22)
    Subtract(x=w15, y=w16) -> w23
    Add(w16, s1) -> w24
    append w17 to w3
    append w22 to w4
    append w14 to w5
    append w16 to w6
    append w24 to w7
    append w18 to w8 if w19
    append w24 to w9 if w19
    next s1 = w24
    next s2 = w23
    next s3 = w16
  }
  $"பருவம்:௴:நாள்கள்" <- w3
  $"பருவநாள்கள்" <- w8
  $"கூட்டுமுழுபருவநாள்கள்" <- w9
  $"பருவம்>௴:நாள்கள்" <- w4
  $"நாள்கள்" <- w5
  $"ஈடுமீதம்" <- s2
  $"முழுநாள்கள்" <- w6
  $"கூட்டுமுழுநாள்கள்" <- w7
  $"கூட்டுதொகை" <- s1
