vi "நேரம் மாற்று.gviweb"   [G Web Development Software 21.0.0]
inputs:
  "ஆங்கிலநாள்": timestamp
  "அடுத்த குறள்": T1 = "நிமையம்"
outputs:
  "காலநேரம்": T9
  "அடுத்தது?": bool
panel indicators:
  "பொழுது (3)": enum{"இரவு", "காலை", "மாலை"}
types:
  T1 = enum{"துளி", "நிமையம்", "கணம்", "மணி", "நாழிகை", "சிறுபொழுது", "நாள்"}
  T2 = enum{"கார்", "கூதிர்", "முன்பனி", "பின்பனி ", "இளவேனில்", "முதுவேனில்"}
  T3 = enum{"ஆவணி", "புரட்டாசி", "ஐப்பசி", "கார்த்திகை", "மார்கழி", "தை", "மாசி", "பங்குனி", "சித்திரை", "வைகாசி", "ஆனி", "ஆடி"}
  T4 = cluster{"பருவம் (6)": T2, "௳(63)": u8, "௴(12)": T3, "௳(32)": u8, "௳(366)": u16}
  T5 = enum{"ஞாயிறு", "திங்கள்", "செவ்வாய்", "அறிவன்", "வியாழன்", "வெள்ளி", "காரி"}
  T6 = cluster{"நிலா (30)": f64, "கிழமை(7)": T5, "மணி(24)": u8, "நிமையம்(60)": u8, "நொடி(60)": f64}
  T7 = cluster{"நாழிகை(60)": u8, "துளி(60)": u8, "தற்பாரை(60)": f64}
  T8 = enum{"மாலை", "இடையாமம்", "வைகறை", "காலை", "நண்பகல்", "எற்பாடு"}
  T9 = cluster{"திருவள்ளுவர்": cluster{"௵": u32, "௳(366)": u16}, "தொல்காப்பியம்": T4, "தெறிப்பு": T6, "பாகை": T7, "நாழிகை": cluster{"சிறுபொழுது (6)": T8, "நாடி(10)": u8}, "துளி": cluster{"கணம்(6)": u8, "விநாடி(10)": u8}, "தற்பாரை": cluster{"அணு(6)": u8, "தற்பாரை(10)": f64}, "தற்பாரை(10)": cluster{"சணிகம்(2)": u8, "நொடி(2)": u8}}
uses:
  நேரம்::குழலிசை::திங்கள்-நாள்கள்.gviweb
diagram:
  Is Equal(x=$"ஆங்கிலநாள்", y=1904-01-01T00:00:00Z) -> w1
  case (w1) {
    frame False, Default {
      w2 = $"ஆங்கிலநாள்"
    }
    frame True {
      Get Current Time() -> (current time=w2)
    }
  }
  Timestamp To Date And Time(time stamp=w2) -> (date time rec=w3)
  # தொல்காப்பியப் பொருள் அதிகாரத்தில் அகத்திணை இயலில் வரும் சூத்திரம்:
  # “காரும் மாலையும் முல்லை; குறிஞ்சி
  # கூதிர் யாமம் என்மனார் புலவர்.
  # பனிஎதிர் பருவமும் மொழிப.
  # வைகறை விடியல் மருதம்; ஏற்பாடு
  # நெய்தலாதல் மெய்பெறத் தோன்றும்
  # நடுவு நிலைத் திணையே நண்பகல் வேனிலொடு
  # முடிவுநிலை மருங்கின் முன்னிய நெறித்தே
  # பின்பனி தானும் உரித்தென மொழிப”
  #
  # என்று நிலங்களுக்கு உரிய ஆறு பெரும் பொழுதுகளையும் ஆறு சிறு பொழுதுகளையும் கூறுவார்.
  Property Node(instance in=w3) -> ("year"=w4, "day of year"=w5, "day of week"=w6, "hour"=w7, "minute"=w8, "second"=w9, "fractional second"=w10)
  Timestamp Subtract(x=w2, y=2021-08-15T12:30:00Z) -> w11
  # கிழமை
  Quotient And Remainder(x=w11, y=86400) -> (floor(x/y)=w12)
  Timestamp Subtract(x=w2, y=2021-08-08T13:50:00Z) -> w13
  Divide(x=w13, y=86400) -> w14
  Quotient And Remainder(x=w14, y=29.5208333333) -> (x-y*floor(x/y)=w15)
  Add(w9, w10) -> w16
  Add(6, w7) -> w17
  case (w17) {
    frame ..23 {
      w18 = w17
      w19 = w6
      w20 = w5
    }
    frame 24.. {
      Increment(x=w5) -> w20
      Increment(x=w6) -> w19
      Subtract(x=w17, y=24) -> w18
    }
  }
  Add(30, w4) -> w21
  Quotient And Remainder(x=w4, y=4) -> (x-y*floor(x/y)=w22)
  Is Equal To 0(x=w22) -> w23
  Boolean To 0 Or 1(Boolean=w23) -> (0, 1=w24)
  case (w20) {
    frame 15.. {
      Increment(x=w21) -> w26
      w25 = w20
    }
    frame ..14 {
      Add(365, w20) -> w25
      w26 = w21
    }
  }
  Decrement(x=w19) -> w27
  To Unsigned 8 Bit Integer(number=w27) -> w28
  Subtract(x=w25, y=13) -> w29
  Subtract(x=w4, y=2020) -> w30
  Increment(x=w30) -> w31
  s1 = 0.17412  # shift register
  s2 = 0  # shift register
  for (N = w31) {
    call "திங்கள்-நாள்கள்.gviweb"(கூட்டுதொடக்கம்=s2, ஈடுசெய்=s1) -> (கூட்டுதொகை=w33, ஈடுமீதம்=w34, கூட்டுமுழுநாள்கள்=w35)
    concatenate w35 onto w32
    next s1 = w34
    next s2 = w33
  }
  Threshold 1D Array(array of numbers or points=w32, threshold y=w12) -> w36
  Round Toward Positive Infinity(x=w36) -> w37
  To Unsigned 16 Bit Integer(number=w37) -> w38
  Quotient And Remainder(x=w38, y=12) -> (x-y*floor(x/y)=w39)
  Quotient And Remainder(x=w39, y=2) -> (floor(x/y)=w40, x-y*floor(x/y)=w41)
  Decrement(x=w37) -> w42
  Decrement(x=w42) -> w43
  Array Index(array=w32) -> (out0[w42]=w44, out1[w43]=w45)
  Subtract(x=w12, y=w44) -> w46
  Subtract(x=w44, y=w45) -> w47
  case (w41) {
    frame 0, Default {
      w48 = w46
    }
    frame 1 {
      Add(w46, w47) -> w48
    }
  }
  w49 = T9 {0, 0, 0, 0, 0, 0, 0, 0, 0, 0, 0, 0, 0, 0, 0, 2, 0, 0, 0, 0, 0, 0, 0}
  Property Node(instance in=w49, "தெறிப்பு:நிலா (30)"=w15, "தொல்காப்பியம்:௳(32)"=w46, "தொல்காப்பியம்:௳(63)"=w48, "தொல்காப்பியம்:௳(366)"=w12, "தொல்காப்பியம்:௴(12)"=w39, "தொல்காப்பியம்:பருவம் (6)"=w40, "திருவள்ளுவர்:௵"=w26, "திருவள்ளுவர்:௳(366)"=w29, "தெறிப்பு:கிழமை(7)"=w28, "தெறிப்பு:மணி(24)"=w18, "தெறிப்பு:நிமையம்(60)"=w8, "தெறிப்பு:நொடி(60)"=w16) -> (instance out=w50)
  Property Node(instance in=w50) -> ("தெறிப்பு:நொடி(60)"=w51, "தெறிப்பு:நிமையம்(60)"=w52, "தெறிப்பு:மணி(24)"=w53, instance out=w54)
  Round Toward Negative Infinity(x=w51) -> w55
  To Unsigned 8 Bit Integer(number=w55) -> w56
  Subtract(x=w51, y=w56) -> w57
  Multiply(w53, 60) -> w58
  Add(w52, w58) -> w59
  Multiply(w59, 60) -> w60
  Add(w56, w60) -> w61
  # சணிகம்    = 2 நொடிகள்
  # விநாடி      = 12 சணிகம்
  #
  # கணம்	     = 10 விநாடி
  # நாழிகை   = 6 கணங்கள்
  # பொழுது   = 10 நாழிகைகள்
  # நாள்         = 6 பொழுதுகள்
  Quotient And Remainder(x=w61, y=24) -> (floor(x/y)=w62, x-y*floor(x/y)=w63)
  Add(w57, w63) -> w64
  Multiply(2.5, w64) -> w65
  Quotient And Remainder(x=w65, y=10) -> (x-y*floor(x/y)=w66)
  Quotient And Remainder(x=w62, y=60) -> (floor(x/y)=w67, x-y*floor(x/y)=w68)
  To Unsigned 8 Bit Integer(number=w68) -> w69
  To Unsigned 8 Bit Integer(number=w67) -> w70
  To Unsigned 8 Bit Integer(number=w63) -> w71
  Quotient And Remainder(x=w71, y=2) -> (floor(x/y)=w72, x-y*floor(x/y)=w73)
  Quotient And Remainder(x=w72, y=2) -> (floor(x/y)=w74, x-y*floor(x/y)=w75)
  Quotient And Remainder(x=w74, y=6) -> (x-y*floor(x/y)=w76)
  Quotient And Remainder(x=w69, y=10) -> (floor(x/y)=w77, x-y*floor(x/y)=w78)
  Quotient And Remainder(x=w77, y=6) -> (x-y*floor(x/y)=w79)
  Quotient And Remainder(x=w70, y=10) -> (floor(x/y)=w80, x-y*floor(x/y)=w81)
  Quotient And Remainder(x=w80, y=6) -> (x-y*floor(x/y)=w82)
  Property Node(instance in=w54, "பாகை:தற்பாரை(60)"=w65, "தற்பாரை:தற்பாரை(10)"=w66, "தற்பாரை(10):நொடி(2)"=w73, "தற்பாரை(10):சணிகம்(2)"=w75, "தற்பாரை:அணு(6)"=w76, "பாகை:துளி(60)"=w69, "துளி:விநாடி(10)"=w78, "துளி:கணம்(6)"=w79, "பாகை:நாழிகை(60)"=w70, "நாழிகை:நாடி(10)"=w81, "நாழிகை:சிறுபொழுது (6)"=w82) -> (instance out=w83)
  case ($"அடுத்த குறள்") {
    frame "கணம்" {
      Property Node(instance in=w83) -> ("துளி:கணம்(6)"=w84)
    }
    frame "சிறுபொழுது" {
      Property Node(instance in=w83) -> ("நாழிகை:சிறுபொழுது (6)"=w84)
    }
    frame "மணி" {
      Property Node(instance in=w83) -> ("தெறிப்பு:மணி(24)"=w84)
    }
    frame "துளி" {
      Property Node(instance in=w83) -> ("துளி:விநாடி(10)"=w84)
    }
    frame "நாழிகை" {
      Property Node(instance in=w83) -> ("நாழிகை:நாடி(10)"=w84)
    }
    frame "நாள்" {
      Property Node(instance in=w83) -> ("தெறிப்பு:கிழமை(7)"=w84)
    }
    frame "நிமையம்" {
      Property Node(instance in=w83) -> ("தெறிப்பு:நிமையம்(60)"=w84)
    }
  }
  s3 = uninitialised  # shift register
  for (N = 1) {
    Is Not Equal(x=w84, y=s3) -> w85
    next s3 = w84
  }
  $"அடுத்தது?" <- w85
  $"காலநேரம்" <- w83
  Quotient And Remainder(x=w40, y=3)
