vi "தகவல்.gviweb"   [G Web Development Software 21.0.0]
panel controls:
  "நேரம்": i32 = 2
  "காலம்": i32 = 2
  "Next": string = "தொடர்முறை.html"
  "அடுத்தது": bool
  "முன்": bool
  "மொழி": T6 = "முத்தமிழ்"
  "அடுத்த குறள்": T7 = "நிமையம்"
panel indicators:
  "கணங்கள்": u8
  "பொழுது": T1
  "நாழிகைகள்": u8
  "நாழிகை": u8
  "விநாடி": u8
  "சணிகம்": u8
  "சிறுபொழுது": u8
  "விநாடிகள்": u8
  "கிழமை": T2
  "நாள்": u16
  "ஆண்டு": u32
  "மாதம்": T3
  "பருவம்": T4
  "மாதங்கள்": u8
  "பருவங்கள்": u8
  "கிழமைகள்": u8
  "மாதநாள்": u8
  "நாட்கள்": u16
  "கணம்": u8
  "சணிகங்கள்": u8
  "மாதநாள்கள்": u8
  "பருவம்:திங்கள்:நாள்கள்": T5[]
  "குறள் எண்": u16
  "திருக்குறள்": string
  "நொடி": bool
  "அணு(6)": u8
types:
  T1 = enum{"மாலை", "இடையாமம்", "வைகறை", "காலை", "நண்பகல்", "எற்பாடு"}
  T2 = enum{"ஞாயிறு", "திங்கள்", "செவ்வாய்", "அறிவன்", "வியாழன்", "வெள்ளி", "காரி"}
  T3 = enum{"ஆவணி", "புரட்டாசி", "ஐப்பசி", "கார்த்திகை", "மார்கழி", "தை", "மாசி", "பங்குனி", "சித்திரை", "வைகாசி", "ஆனி", "ஆடி"}
  T4 = enum{"கார்", "கூதிர்", "முன்பனி", "பின்பனி ", "இளவேனில்", "முதுவேனில்"}
  T5 = cluster{"பருவம்": string, "௴": string, "நாள்கள்": string}
  T6 = enum{"முத்தமிழ்", "ஆங்கிலம் (English)", "தெலுங்கு (తెలుగు)", "மலையாளம் (മലയാളം)", "கன்னடம் (ಕನ್ನಡ)", "சீனம் (汉语)", "மலாய் (Melayu)", "கொரிய (한국어)", "உருசிய (Русский)", "அரபு (العَرَبِيَّة)", "பிரெஞ்சு (Français)", "செர்மன் (Deutsch)", "சுவீடிய (Svenska)", "இலத்தீன் (Latīna)", "போலிய (Polski)"}
  T7 = enum{"துளி", "நிமையம்", "கணம்", "மணி", "நாழிகை", "சிறுபொழுது", "நாள்"}
uses:
  நேரம்::குழலிசை::குறள்தொடக்கம்.gviweb
  நேரம்::குழலிசை::நேரம் மாற்று.gviweb
  நேரம்::குழலிசை::குறள்படி.gviweb
  நேரம்::குழலிசை::திங்கள்-நாள்கள்.gviweb
diagram:
  call "குறள்தொடக்கம்.gviweb"(கணம்?=FALSE) -> (தொடக்கம்=w1)
  s1 = TRUE  # shift register
  s2 = w1  # shift register
  s3 = uninitialised  # shift register
  s4 = uninitialised  # shift register
  while {
    call "நேரம் மாற்று.gviweb"(அடுத்த குறள்=$"அடுத்த குறள்") -> (காலநேரம்=w2, அடுத்தது?=w3)
    Property Node(instance in=w2) -> ("தொல்காப்பியம்:பருவம் (6)"=w4, "திருவள்ளுவர்:௵"=w5, "திருவள்ளுவர்:௳(366)"=w6, "தொல்காப்பியம்:௴(12)"=w7, "தொல்காப்பியம்:௳(32)"=w8, "தெறிப்பு:கிழமை(7)"=w9, "நாழிகை:சிறுபொழுது (6)"=w10, "நாழிகை:நாடி(10)"=w11, "பாகை:துளி(60)"=w12, "துளி:கணம்(6)"=w13, "தற்பாரை:அணு(6)"=w14, "தற்பாரை(10):சணிகம்(2)"=w15, "தற்பாரை(10):நொடி(2)"=w16)
    $"பருவம்" <- w4
    $"பருவங்கள்" <- w4
    $"ஆண்டு" <- w5
    $"நாள்" <- w6
    $"நாட்கள்" <- w6
    $"மாதங்கள்" <- w7
    $"மாதம்" <- w7
    $"மாதநாள்" <- w8
    $"மாதநாள்கள்" <- w8
    $"கிழமைகள்" <- w9
    $"கிழமை" <- w9
    $"சிறுபொழுது" <- w10
    $"பொழுது" <- w10
    $"நாழிகை" <- w11
    $"நாழிகைகள்" <- w11
    $"விநாடிகள்" <- w12
    $"விநாடி" <- w12
    $"கணங்கள்" <- w13
    $"கணம்" <- w13
    $"அணு(6)" <- w14
    $"சணிகம்" <- w15
    $"சணிகங்கள்" <- w15
    Is Equal To 0(x=w16) -> w17
    $"நொடி" <- w17
    case (s1) {
      frame False, Default {
        w18 = s2
        w19 = s4
        w20 = s3
      }
      frame True {
        call "குறள்படி.gviweb"(அடைவு=s2) -> (குறள் எண்=w18, திருக்குறள்=w20, பொருள்=w19)
      }
    }
    Is First Call() -> w21
    Logical Or(w3, w21) -> w22
    case (w22) {
      frame False {
        Logical Or($"அடுத்தது", $"முன்") -> w26
        case ($"முன்") {
          frame False, Default {
            w25 = w18
          }
          frame True {
            Subtract(x=w18, y=2) -> w25
          }
        }
        $"குறள் எண்" <- w18
        Array Index(array=w19) -> (out0[$"மொழி"]=w27)
        Concatenate Strings(w20, "\r\n", w27) -> w28
        $"திருக்குறள்" <- w28
        w23 = w20
        w24 = w19
      }
      frame True {
        w23 = w20
        w24 = w19
        w25 = w18
        w26 = w22
      }
    }
    Wait(time to wait=400)
    next s1 = w26
    next s2 = w25
    next s3 = w23
    next s4 = w24
    stop if FALSE
  }
  call "திங்கள்-நாள்கள்.gviweb"() -> (பருவம்:௴:நாள்கள்=w29)
  $"பருவம்:திங்கள்:நாள்கள்" <- w29
