vi "தொடர்முறை.gviweb"   [G Web Development Software 21.0.0]
panel controls:
  "Next": string = "எண்முறை.html"
  "தெறிப்பு": i32
  "Next_2": string = "தகவல்.html"
  "தொல்காப்பிய பருவம் : நாள்": i32
  "முன்": bool
  "அடுத்தது": bool
  "மொழி": T2 = "முத்தமிழ்"
  "நாழிகை:துளி: தற்பாரை(௬௰)": i32
  "அடுத்த குறள்": T6 = "நிமையம்"
panel indicators:
  "விநாடிகள்": u8
  "தற்பாரைகள்": u8
  "நாள்": u16
  "௵": u32
  "பருவம்> திங்கள் : நாள்கள்": T1[]
  "திருக்குறள்": string
  "நாழிகள்": u8
  "பருவநாள்கள்": u8
  "குறள் எண்": u16
  "௵_1": i32
  "பால்": enum{"அறம்", "பொருள்", "இன்பம்"}
  "இயல்": T3
  "அதிகாரம்": T4
  "௴": T5
  "பருவநாள்": u8
  "நாழி": u8
  "விநாடி": u8
  "தற்பரை": u8
  "நிலா(30)": f64
  "நிலா(30) : கிழமை(7)": i32
  "நிலா": f64
  "கிழமை (7)": T7
  "கிழமை": u8
  "பருவம்": u8
  "பருவம் (௬)": T8
  "தற்பாரை (௰)": cluster{"சணிகம்(௨)": u8, "நொடி(௨)": u8}
  "துளி (௬x௰)": cluster{"கணம்(௬)": u8, "விநாடி(௰)": u8}
  "தற்பாரை (௬x௰)": cluster{"அணு (௬)": u8, "தற்பாரை (௰)": f64}
  "திருவள்ளுவர் ஆண்டு : நாள்": i32
  "ஆண்டுநாள்கள்": u16
  "சிறுபொழுது": T9
  "நாழி(௰)": u8
  "திங்கள்": u8
  "௳": u8
  "URL Image": string
types:
  T1 = cluster{"பருவம்>திங்கள்": string, "data": string}
  T2 = enum{"முத்தமிழ்", "ஆங்கிலம் (English)", "தெலுங்கு (తెలుగు)", "மலையாளம் (മലയാളം)", "கன்னடம் (ಕನ್ನಡ)", "சீனம் (汉语)", "மலாய் (Melayu)", "கொரிய (한국어)", "உருசிய (Русский)", "அரபு (العَرَبِيَّة)", "பிரெஞ்சு (Français)", "செர்மன் (Deutsch)", "சுவீடிய (Svenska)", "இலத்தீன் (Latīna)", "போலிய (Polski)"}
  T3 = enum{"பாயிரவியல்", "இல்லறவியல்", "துறவறவியல்", "ஊழியல் ", "அரசியல்", "அமைச்சியல்", "அரணியல்", "கூழியல்", "படையில்", "நட்பியல்", "குடியியல்", "களவியல்", "கற்பியல்"}
  T4 = enum{"கடவுள் வாழ்த்து", "வான்சிறப்பு", "நீத்தார் பெருமை", "அறன்வலியுறுத்தல்", "இல்வாழ்க்கை", "வாழ்க்கைத் துணைநலம்", "மக்கட்பேறு", "அன்புடைமை", "விருந்தோம்பல்", "இனியவைகூறல்", "செய்ந்நன்றி அறிதல்", "நடுவு நிலைமை", "அடக்கமுடைமை", "ஒழுக்கமுடைமை", "பிறனில் விழையாமை", "பொறையுடைமை", "அழுக்காறாமை", "வெஃகாமை", "புறங்கூறாமை", "பயனில சொல்லாமை", "தீவினையச்சம்", "ஒப்புரவறிதல்", "ஈகை", "புகழ்", "அருளுடைமை", "புலான்மறுத்தல்", "தவம்", "கூடாவொழுக்கம்", "கள்ளாமை", "வாய்மை", "வெகுளாமை", "இன்னாசெய்யாமை", "கொல்லாமை", "நிலையாமை", "துறவு", "மெய்யுணர்தல்", "அவாவறுத்தல்", "ஊழ்", "இறைமாட்சி", "கல்வி", "கல்லாமை", "கேள்வி", "அறிவுடைமை", "குற்றங்கடிதல்", "பெரியாரைத் துணைக்கோடல்", "சிற்றினஞ்சேராமை", "தெரிந்துசெயல்வகை", "வலியறிதல்", "காலமறிதல்", "இடனறிதல்", "தெரிந்துதெளிதல்", "தெரிந்துவினையாடல்", "சுற்றந்தழால்", "பொச்சாவாமை", "செங்கோன்மை", "கொடுங்கோன்மை", "வெருவந்தசெய்யாமை", "கண்ணோட்டம்", "ஒற்றாடல்", "ஊக்கமுடைமை"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}
  T5 = enum{"ஆவணி", "புரட்டாசி", "ஐப்பசி", "கார்த்திகை", "மார்கழி", "தை", "மாசி", "பங்குனி", "சித்திரை", "வைகாசி", "ஆனி", "ஆடி"}
  T6 = enum{"துளி", "நிமையம்", "கணம்", "மணி", "நாழிகை", "சிறுபொழுது", "நாள்"}
  T7 = enum{"ஞாயிறு", "திங்கள்", "செவ்வாய்", "அறிவன்", "வியாழன்", "வெள்ளி", "காரி"}
  T8 = enum{"கார்", "கூதிர்", "முன்பனி", "பின்பனி ", "இளவேனில்", "முதுவேனில்"}
  T9 = enum{"மாலை", "இடையாமம்", "வைகறை", "காலை", "நண்பகல்", "எற்பாடு"}
uses:
  நேரம்::குழலிசை::குறள்தொடக்கம்.gviweb
  நேரம்::குழலிசை::நேரம் மாற்று.gviweb
  நேரம்::குழலிசை::குறள்படி.gviweb
  நேரம்::குழலிசை::திங்கள்-நாள்கள்.gviweb
diagram:
  call "குறள்தொடக்கம்.gviweb"(கணம்?=FALSE) -> (தொடக்கம்=w1)
  s1 = w1  # shift register
  s2 = TRUE  # shift register
  s3 = uninitialised  # shift register
  s4 = uninitialised  # shift register
  s5 = uninitialised  # shift register
  while {
    call "நேரம் மாற்று.gviweb"(அடுத்த குறள்=$"அடுத்த குறள்") -> (காலநேரம்=w2, அடுத்தது?=w3)
    Property Node(instance in=w2) -> ("நாழிகை:சிறுபொழுது (6)"=w4, "தொல்காப்பியம்:௳(63)"=w5, "திருவள்ளுவர்:௵"=w6, "திருவள்ளுவர்:௳(366)"=w7, "தொல்காப்பியம்:பருவம் (6)"=w8, "தெறிப்பு:கிழமை(7)"=w9, "தெறிப்பு:நிலா (30)"=w10, "பாகை:நாழிகை(60)"=w11, "பாகை:துளி(60)"=w12, "பாகை:தற்பாரை(60)"=w13, "நாழிகை:நாடி(10)"=w14, "துளி"=w15, "தற்பாரை"=w16, "தற்பாரை(10)"=w17, "தொல்காப்பியம்:௴(12)"=w18, "தொல்காப்பியம்:௳(32)"=w19)
    $"சிறுபொழுது" <- w4
    $"பருவநாள்" <- w5
    $"பருவநாள்கள்" <- w5
    $"௵" <- w6
    $"௵_1" <- w6
    $"நாள்" <- w7
    $"ஆண்டுநாள்கள்" <- w7
    $"பருவம் (௬)" <- w8
    $"கிழமை (7)" <- w9
    # சணிகம்    = 2 நொடிகள்
    # விநாடி      = 12 சணிகம்
    # கணம்	     = 10 விநாடி
    # நாழிகை   = 6 கணங்கள்
    # பொழுது   = 10 நாழிகைகள்
    # நாள்         = 6 பொழுதுகள்
    $"கிழமை" <- w9
    $"நிலா" <- w10
    $"நிலா(30)" <- w10
    $"நாழி" <- w11
    $"நாழிகள்" <- w11
    $"விநாடி" <- w12
    $"விநாடிகள்" <- w12
    $"தற்பரை" <- w13
    $"தற்பாரைகள்" <- w13
    $"நாழி(௰)" <- w14
    $"துளி (௬x௰)" <- w15
    $"தற்பாரை (௬x௰)" <- w16
    $"தற்பாரை (௰)" <- w17
    $"௴" <- w18
    $"௳" <- w19
    Multiply(w18, 5) -> w20
    Divide(x=w19, y=6.1) -> w21
    To Unsigned 8 Bit Integer(number=w21) -> w22
    Add(w22, w20) -> w23
    $"திங்கள்" <- w23
    $"பருவம்" <- w23
    case (s2) {
      frame False, Default {
        w24 = s1
        w25 = s3
        w26 = s4
        w27 = s5
      }
      frame True {
        call "குறள்படி.gviweb"(அடைவு=s1) -> (குறள் எண்=w24, திருக்குறள்=w26, பொருள்=w25, தகவல்=w27)
      }
    }
    Is First Call() -> w28
    Logical Or(w3, w28) -> w29
    case (w29) {
      frame False {
        Array Index(array=w25) -> (out0[$"மொழி"]=w35)
        Concatenate Strings(w26, "\r\n", w35) -> w36
        $"திருக்குறள்" <- w36
        Logical Or($"அடுத்தது", $"முன்") -> w31
        case ($"முன்") {
          frame False, Default {
            w30 = w24
          }
          frame True {
            Subtract(x=w24, y=2) -> w30
          }
        }
        $"குறள் எண்" <- w24
        Property Node(instance in=w27) -> ("பால்"=w37, "இயல்"=w38, "அதிகாரம்"=w39, instance out=w34)
        $"பால்" <- w37
        $"இயல்" <- w38
        $"அதிகாரம்" <- w39
        w32 = w25
        w33 = w26
      }
      frame True {
        Property Node(instance in=reference to "பருவம்> திங்கள் : நாள்கள்") -> ("Value"=w40, instance out=w41)
        Array Index(array=w40) -> (out0[w18]=w42)
        Property Node(instance in=w42) -> ("பருவம்>திங்கள்"=w43)
        Property Node(instance in=w41, "Selection"=w43)
        w30 = w24
        w31 = w29
        w32 = w25
        w33 = w26
        w34 = w27
      }
    }
    Wait(time to wait=400)
    next s1 = w30
    next s2 = w31
    next s3 = w32
    next s4 = w33
    next s5 = w34
    stop if FALSE
  }
  call "திங்கள்-நாள்கள்.gviweb"() -> (பருவம்>௴:நாள்கள்=w44)
  $"பருவம்> திங்கள் : நாள்கள்" <- w44
